# Dynamo graph script.dyn (Dynamo 2.13.1.3887)

python_script = Python()  # CPython3; unwired: IN[0]
# ---------- python_script.python (76 lines) ----------
# Load the Python Standard and DesignScript Libraries
import clr

import sys
sys.path.append('C:\Program Files (x86)\IronPython 2.7\Lib')

import System
from System import Array
from System.Collections.Generic import *

clr.AddReference('ProtoGeometry')
from Autodesk.DesignScript.Geometry import *

clr.AddReference("RevitNodes")
import Revit
clr.ImportExtensions(Revit.Elements)
clr.ImportExtensions(Revit.GeometryConversion)

clr.AddReference("RevitServices")
import RevitServices
from RevitServices.Persistence import DocumentManager 
from RevitServices.Transactions import TransactionManager 

clr.AddReference("RevitAPI")
clr.AddReference("RevitAPIUI")

import Autodesk 
from Autodesk.Revit.DB import *
from Autodesk.Revit.UI import *

# Current doc/app/ui
doc = DocumentManager.Instance.CurrentDBDocument
uiapp = DocumentManager.Instance.CurrentUIApplication 
app = uiapp.Application 
uidoc = uiapp.ActiveUIDocument

# Get Ids inuse
Inuse_ID_Box = []

for view in FilteredElementCollector(doc).OfClass(View).WhereElementIsNotElementType():
    boxParam = view.get_Parameter(BuiltInParameter.VIEWER_VOLUME_OF_INTEREST_CROP)
    if not boxParam: continue
    
    boxID = boxParam.AsElementId()
    if boxID == ElementId.InvalidElementId: continue
    
    Inuse_ID_Box.append(boxID.IntegerValue)
# Get levels and grid IDS where scope boxes may be assigned
gridFilter = ElementCategoryFilter(BuiltInCategory.OST_Grids) 
levelFilter = ElementCategoryFilter(BuiltInCategory.OST_Levels)
catFilter = LogicalOrFilter(gridFilter, levelFilter)

for elem in FilteredElementCollector(doc).WherePasses(catFilter):
    boxParam = elem.get_Parameter(BuiltInParameter.DATUM_VOLUME_OF_INTEREST)
    if not boxParam: continue
    
    boxID = boxParam.AsElementId()
    if boxID == ElementId.InvalidElementId: continue
    
    Inuse_ID_Box.append(boxID.IntegerValue) 
# Get all IDS and delete
ToDelete_ID_Box = List[ElementId]()

for box in FilteredElementCollector(doc).OfCategory(BuiltInCategory.OST_VolumeOfInterest).WhereElementIsNotElementType():
    if box.Id.IntegerValue in Inuse_ID_Box: continue
    
    ToDelete_ID_Box.Add(box.Id)

# Delete elements
with Transaction(doc, "Delete Unused Scopeboxes") as tr:
    tr.Start()
    doc.Delete(ToDelete_ID_Box)
    tr.Commit()
    
# Assign your output to the OUT variable.
OUT = ToDelete_ID_Box
# ----------------------------------------
